# Grasshopper definition grasshopper 链条 bike chain.gh (Grasshopper 1.0.7)
# plug-ins: Pufferfish, Heteroptera, Vipers, Pancake

curve = Curve([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])

# ----
# 生成主曲线
number_slider = Slider(102, range=0..200)
number_slider_2 = Slider(22, range=0..100)
point = Point(Point(185.4563489, 0, -54.92940784))
point_2 = Point(Point(-300.0805271, 0, -0.1597166657))
point_3 = Point(Point(-350.8279629, 0, -161.3309715))
point_4 = Point(Point(-302.8736151, 0, -82.4943636))
xz_plane = XZPlane(Origin=point)
xz_plane_2 = XZPlane(Origin=point_2)
xz_plane_3 = XZPlane(Origin=point_4)
xz_plane_4 = XZPlane(Origin=point_3)
circle = Circle(Plane=xz_plane, Radius=number_slider)
circle_2 = Circle(Plane=xz_plane_2, Radius=Slider(29, range=0..100))
circle_3 = Circle(Plane=xz_plane_3, Radius=number_slider_2)
circle_4 = Circle(Plane=xz_plane_4, Radius=number_slider_2)
tangent_lines_ex = TangentLinesEx(CircleA=circle, CircleB=circle_2)  # -> Tangent1, Tangent2
tangent_lines_in = TangentLinesIn(CircleA=circle_2, CircleB=circle_3)  # -> Tangent1, Tangent2
tangent_lines_in_2 = TangentLinesIn(CircleA=circle_3, CircleB=circle_4)  # -> Tangent1, Tangent2
tangent_lines_ex_2 = TangentLinesEx(CircleA=circle, CircleB=circle_4)  # -> Tangent1, Tangent2
line = Line(tangent_lines_in.Tangent2)
line_2 = Line(tangent_lines_in_2.Tangent1)
line_3 = Line(tangent_lines_ex.Tangent2)
line_4 = Line(tangent_lines_ex_2.Tangent1)
merge = Merge(Data1=line_3, Data2=line, Data3=line_2, Data4=line_4)
extend_curve = ExtendCurve(Curve=merge, Type=0, Start="10", End="10")
merge_2 = Merge(Data1=circle, Data2=circle_2, Data3=circle_3, Data4=circle_4, Data5=merge)
相交位置打断曲线 = 相交位置打断曲线(一组相交曲线=merge_2, 公差1=0, 公差2=0)  # -> flatten(打断后的曲线)
geometric_region = GeometricRegion(Curves=相交位置打断曲线)  # disabled
area = Area(Geometry=geometric_region)  # -> Area, Centroid; disabled
sort_list = SortList(Keys=area.Area, ValuesA=geometric_region)  # -> Keys, ValuesA; disabled

# ----
# 强制偶数
# 得到点
unit_length = Slider(13, range=0..100)
join_curves = JoinCurves(Curves=curve, Preserve=False)
length = Length(Curve=join_curves)
division = Division(A=length, B=unit_length)
round = Round(Number=division)  # -> Nearest, Floor, Ceiling
division_2 = Division(A=round.Nearest, B=2)
round_2 = Round(Number=division_2)  # -> Nearest, Floor, Ceiling
multiplication = Multiplication(A=round_2.Nearest, B=2)
divide_curve = DivideCurve(Curve=join_curves, Count=multiplication, Kinks=False)  # -> flatten(Points), Tangents, Parameters
shift_list = ShiftList(List=divide_curve.Points, Shift=1, Wrap=True)  # -> flatten(List)
merge_3 = Merge(Data1=graft(divide_curve.Points), Data2=graft(shift_list))

# ----
# 外圈
number_slider_3 = Slider(1.5, range=0..10)
unit_y = UnitY(Factor=1)
negative = Negative(Value=number_slider_3)
line_sdl = LineSDL(Start=divide_curve.Points, Direction=unit_y, Length=graft([number_slider_3, negative]))
number_slider_4 = Slider(4, range=0..50)
join_curves_2 = JoinCurves(Curves=flatten(line_sdl), Preserve=False)
addition = Addition(A=number_slider_4, B=0.7)
pipe = Pipe(Curve=join_curves_2, Radius=number_slider_4, Caps=0)

# ----
# 内圈
unit_y_2 = UnitY(Factor=1)
addition_2 = Addition(A=number_slider_3, B=2.5)
negative_2 = Negative(Value=addition_2)
line_sdl_2 = LineSDL(Start=divide_curve.Points, Direction=unit_y_2, Length=graft([addition_2, negative_2]))
number_slider_5 = Slider(2.5, range=0..10)
join_curves_3 = JoinCurves(Curves=flatten(line_sdl_2), Preserve=False)
addition_3 = Addition(A=number_slider_5, B=0.2)
pipe_2 = Pipe(Curve=join_curves_3, Radius=number_slider_5, Caps=0)

# ----
# 大关节
# 小关节
tree_statistics = TreeStatistics(Tree=merge_3)  # -> Paths, Length, Count
dispatch = Dispatch(List=tree_statistics.Paths, DispatchPattern=[True, False])  # -> ListA, ListB
tree_branch = TreeBranch(Tree=merge_3, Path=dispatch.ListB, MaintainPaths=True)
tree_branch_2 = TreeBranch(Tree=merge_3, Path=dispatch.ListA, MaintainPaths=True)
xz_plane_5 = XZPlane(Origin=tree_branch)
xz_plane_6 = XZPlane(Origin=tree_branch_2)
circle_5 = Circle(Plane=xz_plane_5, Radius=number_slider_4)
circle_6 = Circle(Plane=xz_plane_6, Radius=addition)
number_slider_6 = Slider(27, range=0..100)
list_item = ListItem(List=circle_5, Index=0, Wrap=True)  # -> Item, Item1
list_item_2 = ListItem(List=circle_6, Index=0, Wrap=True)  # -> Item, Item1
tangent_arcs = TangentArcs(CircleA=list_item.Item, CircleB=list_item.Item1, Radius=number_slider_6)  # -> ArcA, ArcB
tangent_arcs_2 = TangentArcs(CircleA=list_item_2.Item, CircleB=list_item_2.Item1, Radius=number_slider_6)  # -> ArcA, ArcB
end_points = EndPoints(Curve=tangent_arcs.ArcA)  # -> Start, End
end_points_2 = EndPoints(Curve=tangent_arcs_2.ArcA)  # -> Start, End
end_points_3 = EndPoints(Curve=tangent_arcs.ArcB)  # -> Start, End
end_points_4 = EndPoints(Curve=tangent_arcs_2.ArcB)  # -> Start, End
line_5 = Line(StartPoint=end_points.Start, EndPoint=end_points_3.Start)
line_6 = Line(StartPoint=end_points_2.Start, EndPoint=end_points_4.Start)
line_7 = Line(StartPoint=end_points.End, EndPoint=end_points_3.End)
line_8 = Line(StartPoint=end_points_2.End, EndPoint=end_points_4.End)
circle_7 = Circle(Plane=xz_plane_6, Radius=addition_3)
circle_8 = Circle(Plane=xz_plane_5, Radius=addition_3)
merge_4 = Merge(Data1=tangent_arcs.ArcA, Data2=tangent_arcs.ArcB, Data3=line_5, Data4=line_7)
merge_5 = Merge(Data1=tangent_arcs_2.ArcA, Data2=tangent_arcs_2.ArcB, Data3=line_6, Data4=line_8)
join_curves_4 = JoinCurves(Curves=merge_4, Preserve=False)
join_curves_5 = JoinCurves(Curves=merge_5, Preserve=False)
shift_paths = ShiftPaths(Data=join_curves_4, Offset=-1)
shift_paths_2 = ShiftPaths(Data=join_curves_5, Offset=-1)
merge_6 = Merge(Data1=circle_5, Data2=shift_paths)
merge_7 = Merge(Data1=circle_6, Data2=shift_paths_2)
region_union = RegionUnion(Curves=merge_6)
region_union_2 = RegionUnion(Curves=merge_7)
shift_paths_3 = ShiftPaths(Data=region_union_2, Offset=-1)
shift_paths_4 = ShiftPaths(Data=region_union, Offset=-1)
region_difference = RegionDifference(CurvesA=shift_paths_3, CurvesB=circle_7)
region_difference_2 = RegionDifference(CurvesA=shift_paths_4, CurvesB=circle_8)

# ----
# 厚度和镜像
number_slider_7 = Slider(1, range=0..1)
boundary_surfaces = BoundarySurfaces(Edges=region_difference_2)
boundary_surfaces_2 = BoundarySurfaces(Edges=region_difference)
negative_3 = Negative(Value=number_slider_7)
offset_surface = OffsetSurface(Surface=boundary_surfaces, Distance=negative_3, BothSides=False, CreateSolid=True)
offset_surface_2 = OffsetSurface(Surface=boundary_surfaces_2, Distance=negative_3, BothSides=False, CreateSolid=True)
addition_4 = Addition(A=number_slider_3, B=0.2)
addition_5 = Addition(A=number_slider_7, B=0.4)
unit_y_3 = UnitY(Factor=addition_4)
move = Move(Geometry=offset_surface, Motion=unit_y_3)  # -> Geometry, Transform
addition_6 = Addition(A=number_slider_3, B=addition_5)
unit_y_4 = UnitY(Factor=addition_6)
move_2 = Move(Geometry=offset_surface_2, Motion=unit_y_4)  # -> Geometry, Transform
merge_8 = Merge(Data1=move_2.Geometry, Data2=move.Geometry)
xz_plane_7 = XZPlane(Origin=Point(0, 0, 0))
mirror = Mirror(Geometry=merge_8, Plane=xz_plane_7)  # -> Geometry, Transform

merge_9 = Merge(Data1=pipe, Data2=merge_8, Data3=mirror.Geometry, Data4=pipe_2)
group = Group(Objects=flatten(merge_9))

mesh_join = MeshJoin(Meshes=flatten(merge_9))
concatenate = Concatenate(FragmentA="C:\Users\luigi\Documents\", FragmentB="1.stl")
export_stl = ExportSTL(Mesh=mesh_join, Relocate=invert(True), SavePath=concatenate, SaveAsBinaryFile=True, SaveNow=Toggle(False))
