# Grasshopper definition keyboard parametric.gh (Grasshopper 1.0.7)
# plug-ins: Pufferfish, Pancake

# 第2行
# 数字键
标准按键宽高_默认15 = Slider(15, range=10..20)
全局间距_默认3 = Slider(3, range=2..4)
# shift
shift_left_right_长度 = Slider(44.2, range=0..100)
# tab
tab_长度 = Slider(24.5, range=0..100)
# capslock
capslock_长度 = Slider(33.5, range=0..100)
# esc
esc_宽度 = Slider(14.6, range=0..20)
esc_高度 = Slider(10, range=0..20)
# 键盘宽度和高度通过第一行决定
# 现有问题是第一行加长之后下面不跟着变
point = Point(Point(0, 0, 0))
# ctrl
panel = Panel("5")
rectangle = Rectangle(Plane=point, XSize=esc_宽度, YSize=esc_高度, Radius=0)  # -> Rectangle, Length
addition = Addition(A=标准按键宽高_默认15, B=全局间距_默认3)
negative = Negative(Value=addition)
unit_y = UnitY(Factor=negative)
addition_2 = Addition(A=标准按键宽高_默认15, B=全局间距_默认3)
negative_2 = Negative(Value=addition_2)
unit_y_2 = UnitY(Factor=negative_2)
move = Move(Geometry=point, Motion=unit_y_2)  # -> Geometry, Transform
move_2 = Move(Geometry=move.Geometry, Motion=unit_y)  # -> Geometry, Transform
addition_3 = Addition(A=标准按键宽高_默认15, B=全局间距_默认3)
negative_3 = Negative(Value=addition_3)
unit_y_3 = UnitY(Factor=negative_3)
move_3 = Move(Geometry=move_2.Geometry, Motion=unit_y_3)  # -> Geometry, Transform
addition_4 = Addition(A=标准按键宽高_默认15, B=全局间距_默认3)
negative_4 = Negative(Value=addition_4)
unit_y_4 = UnitY(Factor=negative_4)
move_4 = Move(Geometry=move_3.Geometry, Motion=unit_y_4)  # -> Geometry, Transform
addition_5 = Addition(A=标准按键宽高_默认15, B=全局间距_默认3)
negative_5 = Negative(Value=addition_5)
unit_y_5 = UnitY(Factor=negative_5)
move_5 = Move(Geometry=move_4.Geometry, Motion=unit_y_5)  # -> Geometry, Transform
第一行按键间距 = Slider(2.3, range=0..10)
rectangle_2 = Rectangle(Plane=move_2.Geometry, XSize=tab_长度, YSize=标准按键宽高_默认15, Radius=0)  # -> Rectangle, Length
rectangle_3 = Rectangle(Plane=move_3.Geometry, XSize=capslock_长度, YSize=标准按键宽高_默认15, Radius=0)  # -> Rectangle, Length
addition_6 = Addition(A=esc_宽度, B=第一行按键间距)
rectangle_4 = Rectangle(Plane=move_4.Geometry, XSize=shift_left_right_长度, YSize=标准按键宽高_默认15, Radius=0)  # -> Rectangle, Length
addition_7 = Addition(A=标准按键宽高_默认15, B=全局间距_默认3)
addition_8 = Addition(A=标准按键宽高_默认15, B=全局间距_默认3)
unit_x = UnitX(Factor=addition_7)
unit_x_2 = UnitX(Factor=addition_6)
unit_x_3 = UnitX(Factor=addition_8)
linear_array = LinearArray(Geometry=move_5.Geometry, Direction=unit_x_3, Count=panel)  # -> Geometry, Transform
rectangle_5 = Rectangle(Plane=linear_array.Geometry, XSize=标准按键宽高_默认15, YSize=标准按键宽高_默认15, Radius=0)  # -> Rectangle, Length
bounding_rectangle = BoundingRectangle(Geometry=rectangle_5.Rectangle, Plane=PlaneXY(0, 0, 0), Axis=0, Slide=0, Union=True)  # -> Bounding, DimensionX, DimensionY
addition_9 = Addition(A=tab_长度, B=全局间距_默认3)
unit_x_4 = UnitX(Factor=addition_9)
move_6 = Move(Geometry=move_2.Geometry, Motion=unit_x_4)  # -> Geometry, Transform
addition_10 = Addition(A=capslock_长度, B=全局间距_默认3)
unit_x_5 = UnitX(Factor=addition_10)
move_7 = Move(Geometry=move_3.Geometry, Motion=unit_x_5)  # -> Geometry, Transform
linear_array_2 = LinearArray(Geometry=move.Geometry, Direction=unit_x, Count=Slider(13, range=0..100))  # -> Geometry, Transform
addition_11 = Addition(A=shift_left_right_长度, B=全局间距_默认3)
unit_x_6 = UnitX(Factor=addition_11)
move_8 = Move(Geometry=move_4.Geometry, Motion=unit_x_6)  # -> Geometry, Transform
linear_array_3 = LinearArray(Geometry=rectangle.Rectangle, Direction=unit_x_2, Count=Slider(16, range=0..100))  # -> Geometry, Transform
linear_array_4 = LinearArray(Geometry=move_5.Geometry, Direction=unit_x_3, Count=Slider(4, range=0..100))  # -> Geometry, Transform
addition_12 = Addition(A=标准按键宽高_默认15, B=全局间距_默认3)
addition_13 = Addition(A=标准按键宽高_默认15, B=全局间距_默认3)
addition_14 = Addition(A=标准按键宽高_默认15, B=全局间距_默认3)
rectangle_6 = Rectangle(Plane=linear_array_2.Geometry, XSize=标准按键宽高_默认15, YSize=标准按键宽高_默认15, Radius=0)  # -> Rectangle, Length
bounding_rectangle_2 = BoundingRectangle(Geometry=linear_array_3.Geometry, Plane=PlaneXY(0, 0, 0), Axis=0, Slide=0, Union=True)  # -> Bounding, DimensionX, DimensionY
unit_x_7 = UnitX(Factor=addition_12)
rectangle_7 = Rectangle(Plane=linear_array_4.Geometry, XSize=标准按键宽高_默认15, YSize=标准按键宽高_默认15, Radius=0)  # -> Rectangle, Length
unit_x_8 = UnitX(Factor=addition_13)
unit_x_9 = UnitX(Factor=addition_14)
bounding_rectangle_3 = BoundingRectangle(Geometry=rectangle_6.Rectangle, Plane=PlaneXY(0, 0, 0), Axis=0, Slide=0, Union=True)  # -> Bounding, DimensionX, DimensionY

list_item = ListItem(List=reverse(linear_array_2.Geometry), Index=0, Wrap=True)
subtraction = Subtraction(A=bounding_rectangle_2.DimensionX, B=bounding_rectangle_3.DimensionX)
move_9 = Move(Geometry=list_item, Motion=unit_x)  # -> Geometry, Transform
subtraction_2 = Subtraction(A=subtraction, B=全局间距_默认3)
rectangle_8 = Rectangle(Plane=move_9.Geometry, XSize=subtraction_2, YSize=标准按键宽高_默认15, Radius=0)  # -> Rectangle, Length

linear_array_5 = LinearArray(Geometry=move_6.Geometry, Direction=unit_x_7, Count=Slider(12, range=0..100))  # -> Geometry, Transform
linear_array_6 = LinearArray(Geometry=move_7.Geometry, Direction=unit_x_8, Count=Slider(11, range=0..100))  # -> Geometry, Transform
bounding_rectangle_4 = BoundingRectangle(Geometry=rectangle_7.Rectangle, Plane=PlaneXY(0, 0, 0), Axis=0, Slide=0, Union=True)  # -> Bounding, DimensionX, DimensionY
expression = Expression(
    x=bounding_rectangle_2.DimensionX,
    y=bounding_rectangle_4.DimensionX,
    z=bounding_rectangle.DimensionX,
    u=全局间距_默认3,
    Expression="x-y-z-u*2")

# ----
# 空格
list_item_2 = ListItem(List=reverse(linear_array_4.Geometry), Index=0, Wrap=True)
move_10 = Move(Geometry=list_item_2, Motion=unit_x_3)  # -> Geometry, Transform
rectangle_9 = Rectangle(Plane=move_10.Geometry, XSize=expression, YSize=标准按键宽高_默认15, Radius=0)  # -> Rectangle, Length

linear_array_7 = LinearArray(Geometry=move_8.Geometry, Direction=unit_x_9, Count=Slider(10, range=0..100))  # -> Geometry, Transform

addition_15 = Addition(A=expression, B=全局间距_默认3)
unit_x_10 = UnitX(Factor=addition_15)
move_11 = Move(Geometry=move_10.Geometry, Motion=unit_x_10)  # -> Geometry, Transform
move_to_point = MoveToPoint(Geometry=rectangle_5.Rectangle, PointA=move_5.Geometry, PointB=move_11.Geometry)  # -> Moved, Vector, Transform

rectangle_10 = Rectangle(Plane=linear_array_5.Geometry, XSize=标准按键宽高_默认15, YSize=标准按键宽高_默认15, Radius=0)  # -> Rectangle, Length
rectangle_11 = Rectangle(Plane=linear_array_6.Geometry, XSize=标准按键宽高_默认15, YSize=标准按键宽高_默认15, Radius=0)  # -> Rectangle, Length
rectangle_12 = Rectangle(Plane=linear_array_7.Geometry, XSize=标准按键宽高_默认15, YSize=标准按键宽高_默认15, Radius=0)  # -> Rectangle, Length
bounding_rectangle_5 = BoundingRectangle(Geometry=flatten([rectangle_11.Rectangle, rectangle_3.Rectangle]), Plane=PlaneXY(0, 0, 0), Axis=0, Slide=0, Union=True)  # -> Bounding, DimensionX, DimensionY

list_item_3 = ListItem(List=reverse(linear_array_6.Geometry), Index=0, Wrap=True)
subtraction_3 = Subtraction(A=bounding_rectangle_2.DimensionX, B=bounding_rectangle_5.DimensionX)
move_12 = Move(Geometry=list_item_3, Motion=unit_x)  # -> Geometry, Transform
subtraction_4 = Subtraction(A=subtraction_3, B=全局间距_默认3)
rectangle_13 = Rectangle(Plane=move_12.Geometry, XSize=subtraction_4, YSize=标准按键宽高_默认15, Radius=0)  # -> Rectangle, Length

bounding_rectangle_6 = BoundingRectangle(Geometry=flatten([rectangle_10.Rectangle, rectangle_2.Rectangle]), Plane=PlaneXY(0, 0, 0), Axis=0, Slide=0, Union=True)  # -> Bounding, DimensionX, DimensionY

list_item_4 = ListItem(List=reverse(linear_array_5.Geometry), Index=0, Wrap=True)
subtraction_5 = Subtraction(A=bounding_rectangle_2.DimensionX, B=bounding_rectangle_6.DimensionX)
move_13 = Move(Geometry=list_item_4, Motion=unit_x)  # -> Geometry, Transform
subtraction_6 = Subtraction(A=subtraction_5, B=全局间距_默认3)
rectangle_14 = Rectangle(Plane=move_13.Geometry, XSize=subtraction_6, YSize=标准按键宽高_默认15, Radius=0)  # -> Rectangle, Length

bounding_rectangle_7 = BoundingRectangle(Geometry=flatten([rectangle_12.Rectangle, rectangle_4.Rectangle]), Plane=PlaneXY(0, 0, 0), Axis=0, Slide=0, Union=True)  # -> Bounding, DimensionX, DimensionY

list_item_5 = ListItem(List=reverse(linear_array_7.Geometry), Index=0, Wrap=True)
subtraction_7 = Subtraction(A=bounding_rectangle_2.DimensionX, B=bounding_rectangle_7.DimensionX)
move_14 = Move(Geometry=list_item_5, Motion=unit_x)  # -> Geometry, Transform
subtraction_8 = Subtraction(A=subtraction_7, B=全局间距_默认3)
rectangle_15 = Rectangle(Plane=move_14.Geometry, XSize=subtraction_8, YSize=标准按键宽高_默认15, Radius=0)  # -> Rectangle, Length

# ----
# 键坑
merge = Merge(
    Data1=linear_array_3.Geometry,
    Data2=rectangle_6.Rectangle,
    Data3=rectangle_8.Rectangle,
    Data4=rectangle_2.Rectangle,
    Data5=rectangle_14.Rectangle,
    Data6=rectangle_3.Rectangle,
    Data7=rectangle_13.Rectangle,
    Data8=rectangle_4.Rectangle,
    Data9=rectangle_15.Rectangle,
    Data10=rectangle_7.Rectangle,
    Data11=rectangle_9.Rectangle,
    Data12=move_to_point.Moved)  # -> flatten(Result)

# ----
# 26字母
merge_2 = Merge(Data1=rectangle_10.Rectangle, Data2=rectangle_11.Rectangle, Data3=rectangle_12.Rectangle)

# ----
# 实际按键轮廓线
number_slider = Slider(0.6, range=0..10)
negative_6 = Negative(Value=number_slider)
offset_curve = OffsetCurve(Distance=negative_6, Plane=PlaneXY(0, 0, 0), Corners=1)

number_slider_2 = Slider(8, range=0..10)
number_slider_3 = Slider(0.5, range=0..10)
fillet = Fillet(Curve=merge_2, Radius=number_slider_2)
fillet_2 = Fillet(Curve=merge, Radius=number_slider_2)

boundary_surfaces = BoundarySurfaces(Edges=fillet)
boundary_surfaces_2 = BoundarySurfaces(Edges=fillet_2)
unit_z = UnitZ(Factor=Slider(2, range=0..10))
extrude = Extrude(Base=boundary_surfaces, Direction=unit_z)
extrude_2 = Extrude(Base=boundary_surfaces_2, Direction=unit_z)

mesh_join = MeshJoin(Meshes=flatten(extrude_2))
mesh_join_2 = MeshJoin(Meshes=flatten(extrude))
panel_2 = Panel("C:\Users\luigi\Documents\")
concatenate = Concatenate(FragmentA=panel_2, FragmentB="1.stl")
concatenate_2 = Concatenate(FragmentA=panel_2, FragmentB="2.stl")
export_stl = ExportSTL(Mesh=mesh_join_2, Relocate=invert(True), SavePath=concatenate, SaveAsBinaryFile=True, SaveNow=Toggle(False))
export_stl_2 = ExportSTL(Mesh=mesh_join, Relocate=invert(True), SavePath=concatenate_2, SaveAsBinaryFile=True, SaveNow=Toggle(False))
