# Grasshopper definition keyborad.gh (Grasshopper 1.0.4)

tab_长度 = Slider(24.5, range=0..100)
shift_left_right_长度 = Slider(42.4, range=0..100)
capslock_长度 = Slider(33.5, range=0..100)
x_每个按键的长度 = Slider(15, range=0..100)
y_每个按键的高度 = Slider(15, range=0..100)
universal_space_全局间距 = Slider(3, range=0..10)
r_按键圆角 = Slider(3, range=0..10)
rectangle = Rectangle(Plane=PlaneXY(0, 0, 0), XSize=tab_长度, YSize=y_每个按键的高度, Radius=r_按键圆角)  # -> Rectangle, Length
rectangle_2 = Rectangle(Plane=PlaneXY(0, 0, 0), XSize=capslock_长度, YSize=y_每个按键的高度, Radius=r_按键圆角)  # -> Rectangle, Length
rectangle_3 = Rectangle(Plane=PlaneXY(0, 0, 0), XSize=shift_left_right_长度, YSize=y_每个按键的高度, Radius=r_按键圆角)  # -> Rectangle, Length
left_begin = Slider(-134, range=-305..300)
unit_x = UnitX(Factor=left_begin)
unit_x_2 = UnitX(Factor=left_begin)
unit_x_3 = UnitX(Factor=left_begin)
move = Move(Geometry=rectangle.Rectangle, Motion=unit_x)  # -> Geometry, Transform
move_2 = Move(Geometry=rectangle_2.Rectangle, Motion=unit_x_2)  # -> Geometry, Transform
move_3 = Move(Geometry=rectangle_3.Rectangle, Motion=unit_x_3)  # -> Geometry, Transform
height = Slider(69, range=-303..300)
panel = Panel("此处为设置起点")
number_slider = Slider(317, range=0..1000)
addition = Addition(A=capslock_长度, B=universal_space_全局间距)
addition_2 = Addition(A=shift_left_right_长度, B=universal_space_全局间距)
division = Division(A=number_slider, B=Slider(2, range=0..10))
_15_6_screen_rectangle = Rectangle(Plane=PlaneXY(0, 0, 0), XSize=number_slider, YSize=Slider(237.7, range=0..1000), Radius=0)  # -> Rectangle, Length
rectangle_4 = Rectangle(Plane=PlaneXY(0, 0, 0), XSize=x_每个按键的长度, YSize=y_每个按键的高度, Radius=r_按键圆角)  # -> Rectangle, Length
number_slider_2 = Slider(6, range=0..1000)
rectangle_5 = Rectangle(Plane=PlaneXY(0, 0, 0), XSize=Slider(14.6, range=0..100), YSize=Slider(10, range=0..100), Radius=r_按键圆角)  # -> Rectangle, Length
addition_3 = Addition(A=left_begin, B=addition)
unit_x_4 = UnitX(Factor=left_begin)
addition_4 = Addition(A=left_begin, B=addition_2)
negative = Negative(Value=division)
rectangle_6 = Rectangle(Plane=PlaneXY(0, 0, 0), XSize=x_每个按键的长度, YSize=y_每个按键的高度, Radius=r_按键圆角)  # -> Rectangle, Length
rectangle_7 = Rectangle(Plane=PlaneXY(0, 0, 0), XSize=x_每个按键的长度, YSize=y_每个按键的高度, Radius=r_按键圆角)  # -> Rectangle, Length
unit_x_5 = UnitX(Factor=left_begin)
rectangle_8 = Rectangle(Plane=PlaneXY(0, 0, 0), XSize=x_每个按键的长度, YSize=y_每个按键的高度, Radius=r_按键圆角)  # -> Rectangle, Length
addition_5 = Addition(A=tab_长度, B=universal_space_全局间距)
unit_y = UnitY(Factor=height)
unit_x_6 = UnitX(Factor=addition_3)
unit_x_7 = UnitX(Factor=addition_4)
unit_x_8 = UnitX(Factor=negative)
rectangle_9 = Rectangle(Plane=PlaneXY(0, 0, 0), XSize=x_每个按键的长度, YSize=y_每个按键的高度, Radius=r_按键圆角)  # -> Rectangle, Length
addition_6 = Addition(A=left_begin, B=addition_5)
unit_x_9 = UnitX(Factor=addition_6)
unit_x_10 = UnitX(Factor=left_begin)
move_4 = Move(Geometry=rectangle_4.Rectangle, Motion=unit_x_4)  # -> Geometry, Transform
move_5 = Move(Geometry=_15_6_screen_rectangle.Rectangle, Motion=unit_x_8)  # -> Geometry, Transform
move_6 = Move(Geometry=rectangle_5.Rectangle, Motion=unit_x_5)  # -> Geometry, Transform
move_7 = Move(Geometry=rectangle_6.Rectangle, Motion=unit_x_7)  # -> Geometry, Transform
move_8 = Move(Geometry=rectangle_7.Rectangle, Motion=unit_x_6)  # -> Geometry, Transform
move_9 = Move(Geometry=rectangle_8.Rectangle, Motion=unit_x_9)  # -> Geometry, Transform
move_10 = Move(Geometry=rectangle_9.Rectangle, Motion=unit_x_10)  # -> Geometry, Transform
move_11 = Move(Geometry=move_6.Geometry, Motion=unit_y)  # -> Geometry, Transform
subtraction = Subtraction(A=height, B=universal_space_全局间距)
subtraction_2 = Subtraction(A=subtraction, B=x_每个按键的长度)
unit_y_2 = UnitY(Factor=subtraction_2)
move_12 = Move(Geometry=move_4.Geometry, Motion=unit_y_2)  # -> Geometry, Transform
subtraction_3 = Subtraction(A=subtraction_2, B=universal_space_全局间距)
subtraction_4 = Subtraction(A=subtraction_3, B=x_每个按键的长度)
unit_y_3 = UnitY(Factor=subtraction_4)
move_13 = Move(Geometry=move.Geometry, Motion=unit_y_3)  # -> Geometry, Transform
unit_y_4 = UnitY(Factor=subtraction_4)
move_14 = Move(Geometry=move_9.Geometry, Motion=unit_y_4)  # -> Geometry, Transform
subtraction_5 = Subtraction(A=subtraction_4, B=universal_space_全局间距)
subtraction_6 = Subtraction(A=subtraction_5, B=x_每个按键的长度)
unit_y_5 = UnitY(Factor=subtraction_6)
move_15 = Move(Geometry=move_2.Geometry, Motion=unit_y_5)  # -> Geometry, Transform
unit_y_6 = UnitY(Factor=subtraction_6)
move_16 = Move(Geometry=move_8.Geometry, Motion=unit_y_6)  # -> Geometry, Transform
subtraction_7 = Subtraction(A=subtraction_6, B=universal_space_全局间距)
subtraction_8 = Subtraction(A=subtraction_7, B=x_每个按键的长度)
unit_y_7 = UnitY(Factor=subtraction_8)
move_17 = Move(Geometry=move_3.Geometry, Motion=unit_y_7)  # -> Geometry, Transform
unit_y_8 = UnitY(Factor=subtraction_8)
move_18 = Move(Geometry=move_7.Geometry, Motion=unit_y_8)  # -> Geometry, Transform
subtraction_9 = Subtraction(A=subtraction_8, B=universal_space_全局间距)
subtraction_10 = Subtraction(A=subtraction_9, B=x_每个按键的长度)
unit_y_9 = UnitY(Factor=subtraction_10)
move_19 = Move(Geometry=move_10.Geometry, Motion=unit_y_9)  # -> Geometry, Transform
panel_2 = Panel(subtraction_2)
number_slider_第一行间距 = Slider(1.9, range=0..10)
addition_7 = Addition(A=y_每个按键的高度, B=universal_space_全局间距)
addition_8 = Addition(A=y_每个按键的高度, B=universal_space_全局间距)
addition_9 = Addition(A=y_每个按键的高度, B=universal_space_全局间距)
addition_10 = Addition(A=y_每个按键的高度, B=universal_space_全局间距)
addition_11 = Addition(A=y_每个按键的高度, B=number_slider_第一行间距)
number_slider_3 = Slider(11, range=0..100)
addition_12 = Addition(A=y_每个按键的高度, B=universal_space_全局间距)
number_slider_4 = Slider(12, range=0..100)
number_slider_5 = Slider(13, range=0..100)
number_slider_6 = Slider(10, range=0..100)
number_slider_7 = Slider(4, range=0..100)
unit_x_11 = UnitX(Factor=addition_7)
unit_x_12 = UnitX(Factor=addition_8)
unit_x_13 = UnitX(Factor=addition_9)
unit_x_14 = UnitX(Factor=addition_10)
unit_x_15 = UnitX(Factor=addition_11)
unit_x_16 = UnitX(Factor=addition_12)
linear_array = LinearArray(Geometry=move_16.Geometry, Direction=unit_x_11, Count=number_slider_3)  # -> Geometry, Transform
linear_array_2 = LinearArray(Geometry=move_14.Geometry, Direction=unit_x_12, Count=number_slider_4)  # -> Geometry, Transform
linear_array_3 = LinearArray(Geometry=move_18.Geometry, Direction=unit_x_13, Count=number_slider_6)  # -> Geometry, Transform
linear_array_4 = LinearArray(Geometry=move_12.Geometry, Direction=unit_x_14, Count=number_slider_5)  # -> Geometry, Transform
linear_array_5 = LinearArray(Geometry=move_11.Geometry, Direction=unit_x_15, Count=Slider(16, range=0..100))  # -> Geometry, Transform
linear_array_6 = LinearArray(Geometry=move_19.Geometry, Direction=unit_x_16, Count=number_slider_7)  # -> Geometry, Transform
space = Slider(88, range=0..100)
multiplication = Multiplication(A=addition_10, B=number_slider_7)
addition_13 = Addition(A=left_begin, B=multiplication)
rectangle_10 = Rectangle(Plane=PlaneXY(0, 0, 0), XSize=space, YSize=y_每个按键的高度, Radius=r_按键圆角)  # -> Rectangle, Length
unit_x_17 = UnitX(Factor=addition_13)
unit_y_10 = UnitY(Factor=subtraction_10)
move_20 = Move(Geometry=rectangle_10.Rectangle, Motion=unit_x_17)  # -> Geometry, Transform
move_21 = Move(Geometry=move_20.Geometry, Motion=unit_y_10)  # -> Geometry, Transform
multiplication_2 = Multiplication(A=addition_7, B=number_slider_3)
addition_14 = Addition(A=left_begin, B=universal_space_全局间距)
multiplication_3 = Multiplication(A=addition_10, B=number_slider_4)
addition_15 = Addition(A=addition_14, B=multiplication_2)
addition_16 = Addition(A=addition_6, B=multiplication_3)
multiplication_4 = Multiplication(A=addition_10, B=number_slider_6)
addition_17 = Addition(A=space, B=addition_13)
rectangle_11 = Rectangle(Plane=PlaneXY(0, 0, 0), XSize=tab_长度, YSize=y_每个按键的高度, Radius=r_按键圆角)  # -> Rectangle, Length
addition_18 = Addition(A=capslock_长度, B=addition_15)
rectangle_12 = Rectangle(Plane=PlaneXY(0, 0, 0), XSize=capslock_长度, YSize=y_每个按键的高度, Radius=r_按键圆角)  # -> Rectangle, Length
multiplication_5 = Multiplication(A=addition_10, B=number_slider_5)
unit_x_18 = UnitX(Factor=addition_16)
addition_19 = Addition(A=universal_space_全局间距, B=addition_17)
addition_20 = Addition(A=addition_4, B=multiplication_4)
rectangle_13 = Rectangle(Plane=PlaneXY(0, 0, 0), XSize=shift_left_right_长度, YSize=y_每个按键的高度, Radius=r_按键圆角)  # -> Rectangle, Length
unit_x_19 = UnitX(Factor=addition_18)
unit_y_11 = UnitY(Factor=subtraction_4)
rectangle_14 = Rectangle(Plane=PlaneXY(0, 0, 0), XSize=Slider(34, range=0..100), YSize=y_每个按键的高度, Radius=r_按键圆角)  # -> Rectangle, Length
rectangle_15 = Rectangle(Plane=PlaneXY(0, 0, 0), XSize=x_每个按键的长度, YSize=y_每个按键的高度, Radius=r_按键圆角)  # -> Rectangle, Length
unit_y_12 = UnitY(Factor=subtraction_6)
unit_x_20 = UnitX(Factor=addition_20)
unit_x_21 = UnitX(Factor=addition_19)
addition_21 = Addition(A=left_begin, B=multiplication_5)
unit_x_22 = UnitX(Factor=addition_21)
move_22 = Move(Geometry=rectangle_11.Rectangle, Motion=unit_x_18)  # -> Geometry, Transform
unit_y_13 = UnitY(Factor=subtraction_2)
move_23 = Move(Geometry=rectangle_12.Rectangle, Motion=unit_x_19)  # -> Geometry, Transform
unit_y_14 = UnitY(Factor=subtraction_10)
unit_y_15 = UnitY(Factor=subtraction_8)
move_24 = Move(Geometry=rectangle_13.Rectangle, Motion=unit_x_20)  # -> Geometry, Transform
move_25 = Move(Geometry=rectangle_14.Rectangle, Motion=unit_x_22)  # -> Geometry, Transform
move_26 = Move(Geometry=rectangle_15.Rectangle, Motion=unit_x_21)  # -> Geometry, Transform
move_27 = Move(Geometry=move_22.Geometry, Motion=unit_y_11)  # -> Geometry, Transform
move_28 = Move(Geometry=move_23.Geometry, Motion=unit_y_12)  # -> Geometry, Transform
move_29 = Move(Geometry=move_24.Geometry, Motion=unit_y_15)  # -> Geometry, Transform
back = Move(Geometry=move_25.Geometry, Motion=unit_y_13)  # -> Geometry, Transform
move_30 = Move(Geometry=move_26.Geometry, Motion=unit_y_14)  # -> Geometry, Transform
addition_22 = Addition(A=y_每个按键的高度, B=universal_space_全局间距)
unit_x_23 = UnitX(Factor=addition_22)
linear_array_7 = LinearArray(Geometry=move_30.Geometry, Direction=unit_x_23, Count=Slider(6, range=0..100))  # -> Geometry, Transform
merge = Merge(Data1=move_15.Geometry, Data2=linear_array.Geometry, Data3=move_28.Geometry)
merge_2 = Merge(Data1=move_17.Geometry, Data2=linear_array_3.Geometry, Data3=move_29.Geometry)
merge_3 = Merge(Data2=linear_array_5.Geometry)
merge_4 = Merge(Data1=move_13.Geometry, Data2=linear_array_2.Geometry, Data3=move_27.Geometry)
merge_5 = Merge(Data1=linear_array_4.Geometry, Data2=back.Geometry)
merge_6 = Merge(Data1=linear_array_6.Geometry, Data2=move_21.Geometry, Data3=linear_array_7.Geometry)
negative_2 = Negative(Value=Slider(0.6, range=0..10))
unit_z = UnitZ(Factor=Slider(2.1, range=0..10))
merge_7 = Merge(Data1=merge_3, Data2=merge_5, Data3=merge_4, Data4=merge, Data5=merge_2, Data6=merge_6)
offset_curve = OffsetCurve(Curve=merge_7, Distance=negative_2, Plane=PlaneXY(0, 0, 0), Corners=1)
boundary_surfaces = BoundarySurfaces(Edges=offset_curve)
extrude = Extrude(Base=boundary_surfaces, Direction=unit_z)
panel_3 = Panel("键坑")
panel_4 = Panel("实际按键轮廓线")
panel_5 = Panel("挤出实体")
