# Grasshopper definition voronoi 2d fast relax kangaroo Constrained anyshape.gh (Grasshopper 1.0.7)
# plug-ins: Kangaroo2 Components, ClipperComponents, Pufferfish, NGon

trigger = Trigger(Interval=1, TimerInterval=5, Target=data_recorder)  # disabled
data_recorder = DataRecorder("1", DataLimit=-10, RecordData=True)
mass_addition = MassAddition(Input=data_recorder)  # -> Result, PartialResults
panel = Panel(mass_addition.Result)

curve = Curve(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)
surface = Surface(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)
surface_2 = Surface(curve)

radius = Slider(8, range=0..10)
count = Slider(132, range=0..1000)

count_2 = Slider(23, range=0..1000)

populate_geometry = PopulateGeometry(Geometry=surface_2, Count=1, Seed=1)
brep_closest_point = BrepClosestPoint(Point=populate_geometry, Brep=surface_2)  # -> Point, Normal, Distance
plane_normal = PlaneNormal(Origin=brep_closest_point.Point, ZAxis=brep_closest_point.Normal)

# ----
# 先做一个缩回
brep_edges = BrepEdges(Brep=surface_2)  # -> Naked, Interior, NonManifold
join_curves = JoinCurves(Curves=brep_edges.Naked, Preserve=False)
polyline_offset = PolylineOffset(
    Polylines=join_curves,
    Distance=Slider(3, range=0..3),
    Plane=plane_normal,
    Tolerance=0.001,
    ClosedFillet=2,
    OpenFillet=0,
    Miter=2)  # -> Contour, Holes
curve_2 = Curve(polyline_offset.Holes)

curve_3 = Curve(curve_2)

surface_3 = Surface(curve_3)
populate_geometry_2 = PopulateGeometry(Geometry=surface_3, Count=count, Seed=1)
spherecollide = SphereCollide(Points=populate_geometry_2, Radius=radius, Strength=1)
onmesh = OnMesh(Points=populate_geometry_2, Mesh=surface_3, Strength=1)
show = Show(G=populate_geometry_2)
entwine = Entwine(Branch00=show, Branch01=spherecollide, Branch02=onmesh, FlattenInputs=True)
zombiesolver = ZombieSolver(GoalObjects=entwine, Threshold=1e-10, Tolerance=0.0001, MaxIterations=50000)  # -> I, V, O
list_length = ListLength(List=entwine)
partition_list = PartitionList(List=zombiesolver.O, Size=flatten(list_length))

# ----
# 碰撞圆预览
explode_tree = ExplodeTree(Data=partition_list)  # -> _0000, _0001
point = Point(explode_tree._0000)
plane_normal_2 = PlaneNormal(Origin=point, ZAxis=brep_closest_point.Normal)
circle = Circle(Plane=plane_normal_2, Radius=radius)

bounding_rectangle = BoundingRectangle(Geometry=surface_2, Plane=plane_normal, Axis=0, Slide=0, Union=True)  # -> Bounding, DimensionX, DimensionY
voronoi = Voronoi(Points=point, Boundary=bounding_rectangle.Bounding, BruteForceOverride=False)

polyline_offset_2 = PolylineOffset(
    Polylines=voronoi,
    Distance=Slider(0.4, range=0..1),
    Plane=plane_normal,
    Tolerance=0.001,
    ClosedFillet=2,
    OpenFillet=0,
    Miter=2)  # -> Contour, Holes
region_intersection = RegionIntersection(CurvesA=curve_3, CurvesB=graft(polyline_offset_2.Holes), Plane=plane_normal)  # disabled

explode = Explode(Curve=voronoi, Recursive=True)  # -> flatten(Segments), Vertices
removeduplicatelines = RemoveDuplicateLines(Lines=explode.Segments, Tolerance=0.01)
trim_with_region = TrimWithRegion(Curve=removeduplicatelines, Region=join_curves, Plane=plane_normal)  # -> flatten(Inside), Outside
curve_4 = Curve(trim_with_region.Inside)

# ----
# 预览
merge = Merge(Data1=curve, Data2=curve_4)
curvepreview = CurvePreview(Curve=merge, Width=Slider(3, range=0..10))
