# Grasshopper definition voronoi 2d relax anemone Constrained anyshape.gh (Grasshopper 1.0.7)
# plug-ins: Anemone, Heteroptera, Pufferfish, ClipperComponents, NGon

# ----
# 比较规则的任意形状平面
# 总区域
curve = Curve(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)
boundary_surfaces = BoundarySurfaces(Edges=curve)
geometry = Geometry(boundary_surfaces)
center = Center(Geometrical=geometry)  # -> Center, Dimension
populate_geometry = PopulateGeometry(Geometry=geometry, Count=3, Seed=1)
plane_fit = PlaneFit(Points=populate_geometry)  # -> Plane, Deviation

# ----
# 释放中心
md_slider = MDSlider(
    SliderMode=0,
    slider_value=Point(0.5074358684, 0.5989089594, 0.5),
    x_domain=Domain(0, 1),
    y_domain=Domain(0, 1),
    z_domain=Domain(0, 1))
md_slider_2 = MDSlider(
    SliderMode=0,
    slider_value=Point(0.548527043, 0.1121360965, 0.5),
    x_domain=Domain(0, 1),
    y_domain=Domain(0, 1),
    z_domain=Domain(0, 1))
evaluate_surface = EvaluateSurface(Surface=reparameterize(geometry), Point=[md_slider, md_slider_2])  # -> Point, Normal, UDirection, VDirection, Frame
point = Point(evaluate_surface.Point)

symbol_simple = SymbolSimple(Style=8, Size=Slider(22, range=0..100), Rotation=0, Colour=RGBA(255, 87, 87, 236))
symbol_display = SymbolDisplay(Location=point, Display=symbol_simple)

# ----
# 缩回边界
brep_edges = BrepEdges(Brep=geometry)  # -> Naked, Interior, NonManifold
join_curves = JoinCurves(Curves=brep_edges.Naked, Preserve=False)
polyline_offset = PolylineOffset(
    Polylines=join_curves,
    Distance=Slider(0.5, range=0..1),
    Plane=plane_fit.Plane,
    Tolerance=0.001,
    ClosedFillet=1,
    OpenFillet=1,
    Miter=2)  # -> Contour, Holes
curve_2 = Curve(polyline_offset.Holes)
boundary_surfaces_2 = BoundarySurfaces(Edges=curve_2)

# ----
# 初始释放区域
number_slider = Slider(2, range=0..20)
move_to_point = MoveToPoint(Geometry=plane_fit.Plane, PointA=plane_fit.Plane, PointB=point)  # -> Moved, Vector, Transform
circle = Circle(Plane=move_to_point.Moved, Radius=number_slider)
boundary_surfaces_3 = BoundarySurfaces(Edges=circle)
populate_geometry_2 = PopulateGeometry(Geometry=boundary_surfaces_3, Count=Slider(80, range=0..300), Seed=1)  # -> flatten(Population)

# ----
# voronoi relax
bounding_rectangle = BoundingRectangle(Geometry=geometry, Plane=plane_fit.Plane, Axis=0, Slide=0, Union=True)  # -> Bounding, DimensionX, DimensionY
boolean_toggle = BooleanToggle(False)
scale = Scale(Geometry=bounding_rectangle.Bounding, Center=center.Center, Factor=1.1)  # -> Geometry, Transform
loop_start = LoopStart(Repeat=Slider(20, range=-1..50), Trigger=boolean_toggle, Data=populate_geometry_2)  # -> port, Counter, Data
panel = Panel(loop_start.Counter)
voronoi = Voronoi(Points=loop_start.Data, Boundary=scale.Geometry, BruteForceOverride=False)
area = Area(Geometry=voronoi)  # -> Area, Centroid
point_list = PointList(Points=area.Centroid, Size=Slider(3, range=0..100))
brep_closest_point = BrepClosestPoint(Point=area.Centroid, Brep=boundary_surfaces_2)  # -> Point, Normal, Distance
loop_end = LoopEnd(
    port=loop_start.port,
    Exit=boolean_toggle,
    Data=brep_closest_point.Point,
    TimeOutVal=0,
    pausedState=False,
    state="Constant output")

data_dam = DataDam(DataDataA=voronoi, BufferDelay=2500000, BufferMode=1)
collision_one_many = CollisionOneMany(Collider=join_curves, Obstacles=graft(data_dam))  # -> Collision, Index
dispatch = Dispatch(List=data_dam, DispatchPattern=flatten(collision_one_many.Collision))  # -> ListA, ListB
curve_3 = Curve(dispatch.ListB)
curve_4 = Curve(dispatch.ListA)

# ----
# 此处需要中心点和中点共同判断
curve_5 = Curve(graft(curve_4))
data = Data(join_curves)
split_with_brep = SplitWithBrep(Curve=curve_5, Brep=data)  # -> Curve, Points
curve_middle = CurveMiddle(Curve=split_with_brep.Curve)
center_2 = Center(Geometrical=split_with_brep.Curve, referenceAll=0)  # -> Center, Dimension
point_in_curve = PointInCurve(Point=curve_middle, Curve=data)  # -> Relationship, Point
point_in_curve_2 = PointInCurve(Point=center_2.Center, Curve=data)  # -> Relationship, Point
equality = Equality(FirstNumber=point_in_curve.Relationship, SecondNumber=2)  # -> Equality, Inequality
equality_2 = Equality(FirstNumber=point_in_curve_2.Relationship, SecondNumber=2)  # -> Equality, Inequality
gate_and = GateAnd(A=equality_2.Equality, B=equality.Equality)
dispatch_2 = Dispatch(List=split_with_brep.Curve, DispatchPattern=gate_and)  # -> ListA, ListB
curve_6 = Curve(dispatch_2.ListA)

# ----
# 边界重建
split_with_brep_2 = SplitWithBrep(Curve=data, Brep=curve_5)  # -> Curve, Points
center_3 = Center(Geometrical=split_with_brep_2.Curve)  # -> Center, Dimension
polyline_containment = PolylineContainment(Polyline=curve_5, Point=center_3.Center, Plane=plane_fit.Plane, Tolerance=0.001)
dispatch_3 = Dispatch(List=split_with_brep_2.Curve, DispatchPattern=polyline_containment)  # -> ListA, ListB
curve_7 = Curve(dispatch_3.ListA)

# ----
# 每一个cell都是独立的
join_curves_2 = JoinCurves(Curves=[curve_6, curve_7], Preserve=False)
flip_curve = FlipCurve(Curve=curve_3)  # -> Curve, Flag
merge = Merge(Data1=flip_curve.Curve, Data2=join_curves_2)  # -> flatten(Result)
curvepreview = CurvePreview(Curve=merge, Width=Slider(4, range=0..10), Colour=RGB(0, 0, 0))
