# Grasshopper definition 一键爆炸 explode view.gh (Grasshopper 1.0.7)
# plug-ins: Heteroptera, NGon

geometry = Geometry([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])
center = Center(Geometrical=geometry, forall=True)  # -> Center, Dimension
center_2 = Center(Geometrical=geometry)  # -> Center, Dimension
vector_2pt = Vector2Pt(PointA=center.Center, PointB=center_2.Center, Unitize=False)  # -> Vector, Length
amplitude = Amplitude(Vector=vector_2pt.Vector, Amplitude=Slider(58, range=0..100))

# ----
# 沿某一方向爆炸
deconstruct_vector = DeconstructVector(Vector=amplitude)  # -> XComponent, YComponent, ZComponent
vector_xyz = VectorXYZ(XComponent=0, YComponent=0, ZComponent=deconstruct_vector.ZComponent)  # -> Vector, Length

move = Move(Geometry=geometry, Motion=amplitude)  # -> Geometry, Transform
move_2 = Move(Geometry=center_2.Center, Motion=amplitude)  # -> Geometry, Transform
line = Line(StartPoint=center_2.Center, EndPoint=move_2.Geometry)
panel = Panel("""2
4""")
dash_pattern = DashPattern(Curve=line, Pattern=panel)  # -> Dashes, Gaps
curvepreview = CurvePreview(Curve=dash_pattern.Dashes)
