# Grasshopper definition 正宗冰裂纹 中国传统纹理 grasshopper.gh (Grasshopper 1.0.7)
# plug-ins: ClipperComponents, Heteroptera, Vipers, NGon

extend = Slider(10, range=0..20)
extend_2 = Slider(5, range=0..20)
# 正宗建筑冰裂纹
size = Slider(13.9, range=0..20)

# ----
# 三角形用这个
# -------------------
# 正方形用这个
hexagonal = Hexagonal(Plane=PlaneXY(0, 0, 0), Size=size, ExtentX=extend, ExtentY=extend_2)  # -> Cells, Points
rectangular = Rectangular(Plane=PlaneXY(0, 0, 0), SizeX=size, SizeY=size, ExtentX=extend, ExtentY=extend_2)  # -> Cells, Points

number_slider = Slider(6, range=0..20)

# ----
# 旋转点阵
整体旋转 = Slider(12, range=0..100)
rotate = Rotate(Geometry=hexagonal.Points, Angle=degrees(整体旋转), Plane=PlaneXY(0, 0, 0))  # -> Geometry, Transform
xy_plane = XYPlane(Origin=rotate.Geometry)
单元旋转 = Slider(45, range=-100..100)
rotate_2 = Rotate(Geometry=xy_plane, Angle=degrees(单元旋转), Plane=rotate.Geometry)  # -> Geometry, Transform

控制随机幅度 = Slider(0, range=0..10)

# ----
# 另外一个类似的图案
hexagonal_2 = Hexagonal(Plane=PlaneXY(0, 0, 0), Size=Slider(10, range=0..20), ExtentX=number_slider, ExtentY=number_slider)  # -> Cells, Points
negative = Negative(Value=Slider(3.9, range=0..10))
offset_curve = OffsetCurve(Curve=hexagonal_2.Cells, Distance=negative, Plane=PlaneXY(0, 0, 0), Corners=1)
shift_paths = ShiftPaths(Data=offset_curve, Offset=-1)
rotate_3 = Rotate(Geometry=shift_paths, Angle=degrees(Slider(-29, range=-124..100)), Plane=hexagonal_2.Points)  # -> Geometry, Transform
explode = Explode(Curve=rotate_3.Geometry, Recursive=True)  # -> Segments, Vertices
explode_2 = Explode(Curve=hexagonal_2.Cells, Recursive=True)  # -> Segments, Vertices
cull_index = CullIndex(List=explode.Vertices, Indices=0, Wrap=True)
curve_middle = CurveMiddle(Curve=explode_2.Segments)
shift_paths_2 = ShiftPaths(Data=cull_index, Offset=-1)
line = Line(StartPoint=curve_middle, EndPoint=shift_paths_2)
merge = Merge(Data1=line, Data2=rotate_3.Geometry)  # -> flatten(Result)

# ----
# 绘制基础图案
切换三角形和正方形 = Slider(3, range=3..4)
单元大小 = Slider(11.6, range=0..50)
polygon = Polygon(Plane=rotate_2.Geometry, Radius=单元大小, Segments=切换三角形和正方形, FilletRadius=0)  # -> Polygon, Length

# ----
# 添加随机效果
explode_3 = Explode(Curve=polygon.Polygon, Recursive=True)  # -> Segments, Vertices
tree_statistics = TreeStatistics(Tree=explode_3.Segments)  # -> Paths, Length, Count
list_length = ListLength(List=tree_statistics.Paths)
negative_2 = Negative(Value=控制随机幅度)
random = Random(Range=list_length, Number=list_length, Seed=2)
construct_domain = ConstructDomain(DomainStart=negative_2, DomainEnd=控制随机幅度)
random_2 = Random(Range=construct_domain, Number=切换三角形和正方形, Seed=random)
curve_middle_2 = CurveMiddle(Curve=explode_3.Segments)
rotate_4 = Rotate(Geometry=explode_3.Segments, Angle=degrees(random_2), Plane=curve_middle_2)  # -> Geometry, Transform

# ----
# 简化线条
data_dam = DataDam(DataDataA=rotate_4.Geometry, BufferDelay=5000000, BufferMode=1)
number_slider_2 = Slider(5.7, range=0..10)
simplify_tree = SimplifyTree(Tree=data_dam, Front=False)
extend_curve = ExtendCurve(Curve=simplify_tree, Type=0, Start=number_slider_2, End=number_slider_2)
geometric_region = GeometricRegion(Curves=extend_curve)
join_curves = JoinCurves(Curves=geometric_region, Preserve=False)

# ----
# 暴力计算，图案多了会卡
# 延长每条边，生成图案
data_dam_2 = DataDam(DataDataA=join_curves, BufferDelay=5000000, BufferMode=1)
simplify_curve = SimplifyCurve(Curve=data_dam_2)  # -> Curve, Simplified
一般不动_视情况调节 = Slider(10, range=0..10)
explode_4 = Explode(Curve=simplify_curve.Curve, Recursive=True)  # -> Segments, Vertices
extend_curve_2 = ExtendCurve(Curve=explode_4.Segments, Type=0, Start=一般不动_视情况调节, End=0)
相交位置打断曲线 = 相交位置打断曲线(一组相交曲线=flatten(extend_curve_2), 公差1=0, 公差2=0)
curve_middle_3 = CurveMiddle(Curve=相交位置打断曲线)
point_in_curves = PointInCurves(Point=flatten(curve_middle_3), Curves=flatten(data_dam_2))  # -> Relationship, Index, Point
equality = Equality(FirstNumber=point_in_curves.Relationship, SecondNumber=2)  # -> Equality, Inequality
dispatch = Dispatch(List=flatten(相交位置打断曲线), DispatchPattern=equality.Equality)  # -> ListA, ListB
curve = Curve(dispatch.ListB)
group = Group(Objects=curve)

# ----
# 生成宽度
number_slider_3 = Slider(39, range=0..100)
polyline_offset = PolylineOffset(
    Polylines=flatten(curve),
    Distance=Slider(0.6, range=0..10),
    Plane=Plane(origin=(0, 0, 0), x=(0, 0, 0), y=(0, 0, 0)),
    Tolerance=0.001,
    ClosedFillet=0,
    OpenFillet=0,
    Miter=number_slider_3)  # -> Contour, Holes; disabled
merge_2 = Merge(Data1=polyline_offset.Contour, Data2=polyline_offset.Holes)
data_dam_3 = DataDam(DataDataA=merge_2, BufferDelay=10000000, BufferMode=0)
boundary_surfaces = BoundarySurfaces(Edges=data_dam_3)

curvepreview = CurvePreview(Curve=curve, Width=Slider(3.6, range=0..10))
