# Grasshopper definition 螺旋 voronoi trigger 动画.gh (Grasshopper 1.0.7)
# Copyright: luigi
# plug-ins: Vipers, Pufferfish, NGon

trigger = Trigger(Interval=20, TimerInterval=20, Target=data_recorder)  # disabled
panel = Panel("1")
data_recorder = DataRecorder("-1", DataLimit=-10, RecordData=True)
mass_addition = MassAddition(Input=data_recorder)  # -> Result, PartialResults
panel_2 = Panel(mass_addition.Result)

number_slider = Slider(1, range=1..300)
阿基米德螺线ⅰ = 阿基米德螺线Ⅰ(
    螺旋形中心点=Point(0, 0, 0),
    螺旋线平面=PlaneXY(0, 0, 0),
    增量=Slider(3, range=0..10),
    周期=Slider(9, range=0..20),
    每圈控制点的数量=Slider(10, range=0..10))  # -> 生成的螺旋点, 阿基米德螺旋线
bounding_rectangle = BoundingRectangle(Geometry=阿基米德螺线ⅰ.阿基米德螺旋线, Plane=PlaneXY(0, 0, 0), Axis=0, Slide=0, Union=True)  # -> Bounding, DimensionX, DimensionY
divide_curve = DivideCurve(Curve=阿基米德螺线ⅰ.阿基米德螺旋线, Count=mass_addition.Result, Kinks=False)  # -> Points, Tangents, Parameters
voronoi = Voronoi(Points=divide_curve.Points, Boundary=bounding_rectangle.Bounding, BruteForceOverride=False)
curvepreview = CurvePreview(Curve=voronoi, Width=Slider(3, range=0..10))
